# Grasshopper definition model_creation_workflows.gh (Grasshopper 1.0.7)

# ----
# Solids-to-Rooms Workflow
toggle = BooleanToggle(True)
geo = Geometry([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])
intsolid = HBIntersectSolids(solids=flatten(geo), run=toggle)  # -> int_solids; plug-in component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
geo_2 = Geometry([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])
aperture = HBAperture(geo=geo_2)  # -> report, apertures; plug-in component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
roomsolid = HBRoomFromSolid(geo=flatten(intsolid), name="Residence", conditioned=True, run=toggle)  # -> report, rooms; plug-in component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
bordershades = HBExtrudedBorderShades(hb_objs=flatten(aperture.apertures), depth="0.3", run=Toggle(True))  # -> report, hb_objs; plug-in component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
addsubface = HBAddSubface(hb_obj=roomsolid.rooms, sub_faces=flatten(bordershades.hb_objs))  # -> hb_obj; plug-in component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
geo_3 = Geometry([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])
solveadj = HBSolveAdjacency(rooms=flatten(addsubface), run=toggle)  # -> report, adj_rooms; plug-in component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
shade = HBShade(geo=geo_3)  # -> report, shades; plug-in component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
house_shades = Data(flatten(shade.shades))
house_rooms = Data(flatten(solveadj.adj_rooms))

# ----
# Object-by-Object Workflow
#            [High Customization]
panel = Panel("TinyHouseFace")
geo_4 = Geometry(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)
geo_5 = Geometry(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)
geo_6 = Geometry(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)
geo_7 = Geometry([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])
geo_8 = Geometry(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)
aperture_2 = HBAperture(geo=geo_7)  # -> report, apertures; plug-in component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
aperture_3 = HBAperture(geo=geo_5)  # -> report, apertures; plug-in component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
shade_2 = HBShade(geo=geo_4)  # -> report, shades; plug-in component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
door = HBDoor(geo=geo_8)  # -> report, doors; plug-in component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
face = HBFace(geo=geo_6, name=panel)  # -> report, faces; plug-in component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
addshade = HBAddShade(hb_obj=aperture_3.apertures, out_shades=flatten(shade_2.shades))  # -> hb_obj; plug-in component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
addsubface_2 = HBAddSubface(hb_obj=face.faces, sub_faces=flatten([addshade, door.doors, aperture_2.apertures]))  # -> hb_obj; plug-in component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
geo_9 = Geometry(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)
geo_10 = Geometry(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)
shade_3 = HBShade(geo=geo_9)  # -> report, shades; plug-in component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
shade_4 = HBShade(geo=geo_10)  # -> report, shades; plug-in component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
room = HBRoom(faces=flatten(addsubface_2), name="TinyHouse", conditioned=Toggle(True))  # -> report, room; plug-in component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
addshade_2 = HBAddShade(hb_obj=room.room, out_shades=flatten(shade_3.shades), in_shades=flatten(shade_4.shades))  # -> hb_obj; plug-in component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
tiny_house_room = Data(flatten(addshade_2))

facparam = HBFacadeParameters(north=0, east=Toggle(False), south=0, west=Toggle(True))  # -> fac_par; plug-in component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

facparam_2 = HBFacadeParameters(north="0.5", east="1", south="0.5", west="1")  # -> fac_par; plug-in component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

facparam_3 = HBFacadeParameters(north="0", east="45", south="0", west="-45")  # -> fac_par; plug-in component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

# ----
# Solids-to-Rooms Workflow
#                [High Automation]
research_lab = Geometry([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])
lab_support = Geometry([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])
conference = Geometry([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])
toggle_2 = BooleanToggle(True)
classroom = Geometry([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])
corridor = Geometry([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])
wrietup = Geometry(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)
storage = Geometry([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])
offices = Geometry([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])
all_rooms = Geometry([offices, wrietup, conference, classroom, corridor, storage, research_lab, lab_support])
roomsolid_2 = HBRoomFromSolid(geo=flatten(all_rooms), name="LabBuilding", conditioned=True, run=toggle_2)  # -> report, rooms; plug-in component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
solveadj_2 = HBSolveAdjacency(rooms=flatten(roomsolid_2.rooms), run=toggle_2)  # -> report, adj_rooms; plug-in component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
aperturesbyratio = HBAperturesByRatio(hb_objs=flatten(solveadj_2.adj_rooms), ratio="0.35", win_height="2.8", run=toggle_2)  # -> report, hb_objs; plug-in component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
louvershades = HBLouverShades(
    hb_objs=flatten(aperturesbyratio.hb_objs),
    depth=facparam_2,
    angle=facparam_3,
    vertical=Toggle(True),
    flip_start=facparam,
    run=toggle_2)  # -> report, hb_objs; plug-in component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
multiplier = HBSetMultiplier(rooms=louvershades.hb_objs, multiplier="4")  # -> report, rooms; plug-in component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
lab_rooms = Data(flatten(multiplier.rooms))

roomattr = HBRoomAttributes({"Simulation Name": "name", "Display Name": "display_name", "Multiplier": "multiplier", "Volume": "volume", "Floor Area": "floor_area", "Exposed Area": "exposed_area", "Exterior Wall Area": "exterior_wall_area", "Exterior Aperture Area": "exterior_aperture_area", "Average Floor Height": "average_floor_height"}, selected="Simulation Name")
roomenergyattr = Honeybee_ZoneAttributeList({"Program": "properties.energy.program_type.name", "Construction Set": "properties.energy.construction_set.name", "Is Conditioned": "properties.energy.is_conditioned", "People per Area [ppl/m2]": "properties.energy.people.people_per_area", "Area per Person [m2/ppl]": "properties.energy.people.area_per_person", "Lighting per Area [W/m2]": "properties.energy.lighting.watts_per_area", "Electric Equipment per Area [W/m2]": "properties.energy.electric_equipment.watts_per_area", "Gas Equipment per Area [W/m2]": "properties.energy.gas_equipment.watts_per_area", "Infiltration per Exterior Area [m3/s-m2]": "properties.energy.infiltration.flow_per_exterior_area", "Ventilation per Person [m3/s-ppl]": "properties.energy.ventilation.flow_per_person"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}, selected="Program")
faceattr = HBFaceAttributes({"Simulation Name": "name", "Display Name": "display_name", "Boundary Condition": "boundary_condition", "Has Parent": "has_parent", "Parent": "parent", "Area": "area", "Perimeter": "perimeter", "Face Type": "type", "Aperture Is Operable": "is_operable", "Door Is Glass": "is_glass"}, selected="Simulation Name")
faceenergyattr = Honeybee_ZoneAttributeList({"Construction": "properties.energy.construction.name", "Materials": "properties.energy.construction.layers", "R-Value": "properties.energy.construction.r_value", "U-Value": "properties.energy.construction.u_value", "U-Factor": "properties.energy.construction.u_factor", "Solar Transmitance [Unshaded]": "properties.energy.construction.unshaded_solar_transmittance", "Solar Reflectance [Outside]": "properties.energy.construction.outside_solar_reflectance", "Solar Reflectance [Inside]": "properties.energy.construction.inside_solar_reflectance"}, selected="Construction")

# ----
# Create a Model
model = HBModel(rooms=flatten(house_rooms), shades=flatten(house_shades))  # -> report, model; plug-in component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
deconstructmodel = HBDeconstructModel(model=model.model)  # -> rooms, faces, apertures, doors, shades; plug-in component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

# ----
# Edit
# Geometry
scale = HBScale()  # -> hb_obj; plug-in component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
rotate = HBRotate()  # -> hb_obj; plug-in component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
mirror = HBMirror()  # -> hb_obj; plug-in component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
move = HBMove()  # -> hb_obj; plug-in component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
decnstrobj = HBDeconstructObject()  # -> faces, apertures, doors, shades; plug-in component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

# ----
# Visualize
# Geometry
labelrooms = HBLabelRooms(attribute=roomattr)  # -> label_text, base_pts, labels, wire_frame; plug-in component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
lablefaces = HBLabelFaces(attribute=faceenergyattr, sub_faces=Toggle(False))  # -> label_text, base_pts, labels, wire_frame; plug-in component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
vizbytype = HBVisualizeByType()  # -> walls, interior_walls, roofs, ceilings, exterior_floors, interior_floors, air_walls, apertures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; plug-in component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
vizquick = HBVizualizeQuick()  # -> geo; plug-in component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
vizwiref = HBVizualizeWireframe()  # -> geo; plug-in component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
vizall = HBVizualizeAll()  # -> geo; plug-in component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
vizbybc = HBVizualizeByBC()  # -> outdoors, surface, ground, adiabatic, other; plug-in component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

panel_2 = Panel("C:\Users\chris\Documents\GitHub\honeybee-grasshopper-core\honeybee_grasshopper_core")
createuo = LBCreateUserObject(folder=panel_2, change_type="feat", export=Toggle(False))  # -> read_me; plug-in component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
